% Simulink data dictionary ram_test.sldd

Param = Simulink.Parameter([1 2 3 4 5 6 7 8 9 10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 100], StorageClass="Const", DataType="single")
Param1 = Simulink.Parameter([1 2 0 0 0 0 0 0 0 0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 0], DataType="single")
Sig = Simulink.Signal(StorageClass="Struct", StructName="test_struct", DataType="single")